# Grasshopper definition exampleDefinition.gh (Grasshopper 0.9.76)
# plug-ins: Tortuga

# Material
panel = Panel("C:\Users\mthumfart\Documents\GitHub\Tortuga\exampleData.csv")
material_editor = TortugaMaterialEditor(Path=panel, material="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")
material_editor_2 = TortugaMaterialEditor(Path=panel, material="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")

# ----
# Beams by Distance
# Offset
profiles = TortugaProfiles()
item = ListItem(List=profiles, Index=0, Wrap=True)
profile_layer = TortugaProfileLayer(Profile=item, Material=material_editor_2, Distance=Slider(500, range=0..1000))
material_assembly = TortugaMaterialAssembly(Layer=profile_layer)

# ----
# Stacked Layer
# 80 % Material A
# 20% Material B
# Layer Thickness
number_slider = Slider(50, range=0..100)
panel_2 = Panel("""0.8
0.2""")
stacked_material_layer = TortugaStackedMaterialLayer(Materials=[material_editor_2, material_editor], Widths=panel_2, Thickness=number_slider)
material_assembly_2 = TortugaMaterialAssembly(Layer=stacked_material_layer)

# ----
# Standard Layer
number_slider_2 = Slider(0.5, range=0..1)
material_layer = TortugaMaterialLayer(Material=material_editor_2, Thickness=number_slider_2)
material_assembly_3 = TortugaMaterialAssembly(Layer=material_layer)

# ----
# Geometry
polygon = Polygon(Plane=PlaneXY(0, 0, 0), Radius=3, Segments=6, FilletRadius=0)  # -> Polygon, Length
boundary = BoundarySurfaces(Edges=polygon.Polygon)
pcen = PolygonCenter(Polyline=polygon.Polygon)  # -> CenterV, CenterE, CenterA
Z = UnitZ(Factor=1)
move = Move(Geometry=pcen.CenterV, Motion=Vector(0, 0, 10))  # -> Geometry, Transform
extr = Extrude(Base=boundary, Direction=Z)

# ----
# Multiplicator
number_slider_3 = Slider(1, range=0..1)
multiplication = TortugaMaterialMultiplication(Material=material_assembly_3, Factor=number_slider_3)

pt = Point(move.Geometry)
brep = Brep(extr)
srf = Surface(boundary)

# ----
# Calculation
number_slider_4 = Slider(1, range=0..1)
number_slider_5 = Slider(4, range=0..10)
calculator = TortugaVolumeCalculator(Material=multiplication, Brep=brep)
calculator_2 = TortugaFoundationCalculator(
    Material=multiplication,
    Point=pt,
    Piles=Slider(3, range=0..10),
    PileRadius=Slider(0.4, range=0..1),
    PileLength=number_slider_5,
    PlateThickness=number_slider_4,
    PlateLength=number_slider_5,
    PlateWidth=number_slider_5)
calculator_3 = TortugaCalculator(Material=multiplication, Surface=srf)

# ----
# Result
calculator_result = TortugaCalculatorResult(LCAResult=[calculator_3, calculator, calculator_2])  # -> GlobalWarmingPotential, Acidification, DepletionOfNonrenewbles, DepletionOfOzoneLayer, Eutrophication, FormationTroposphericOzone
panel_3 = Panel([calculator_result.GlobalWarmingPotential, calculator_result.Acidification, calculator_result.DepletionOfNonrenewbles, calculator_result.DepletionOfOzoneLayer, calculator_result.Eutrophication, calculator_result.FormationTroposphericOzone])
